# Dynamo graph CreateTopoFromLandXml.dyn (Dynamo 2.6.1.8786)

# note: Note to LandXML's data:
# Surface must have structure "faces" and "points". If there are using feature lines or other surfaces/elements please export 3D-faces from surface(s) and add to empty surface.
file_path_to_landxml_file = Filename("..\Drawings\ZD_DemoSurface1.xml")  # graph input
# note: Script description
# Current script work with custom's .NET Framework DLL (4.8); you can find it on https://github.com/GeorgGrebenyuk/TopoSurfaceToRevit
# Description of working you can find at article here (Russian version)
# https://zen.yandex.ru/media/id/5d0dba97ecd5cf00afaf2938/autodesk-revit-sposoby-tochnoi-peredachi-proektnoi-poverhnosti-6155dd4f62dc6033c17d7042
# English description looks at repo
unit_s_coefficient = CodeBlock { 1/0.3048; }
getPointsAndFacesFromLandxml = CreateTopoTest.MainClass.GetPointsAndFacesFromLandxml(PathToLandxml=file_path_to_landxml_file, UnitsCoeff=unit_s_coefficient)
createTopo = CreateTopoTest.MainClass.CreateTopo(Topo_Points=getPointsAndFacesFromLandxml.Topo_Points, Topo_Faces=getPointsAndFacesFromLandxml.Topo_Faces)
